# Grasshopper definition Block table layout.gh (Grasshopper 1.0.7)
# Copyright: Co-de-iT
# plug-ins: eleFront Rhino 6 Legacy

listblockd_r6 = ListBlockDocumentR6()
pt = Point(Point(0, 0, 0))
expansion = Slider(1.5, range=1..2)
rows = Slider(4, range=1..20)
# <title>
# 
# <description>
# 
# code by Alessio Erioli
# 
# v 0.1
inblock_r6 = InsertBlockR6(BlockName=listblockd_r6, SourcePlane=PlaneXY(0, 0, 0))
lng = ListLength(List=listblockd_r6)
bbox = BoundingBox(Content=inblock_r6, Plane=PlaneXY(0, 0, 0), UnionBox=True)  # -> Box, Box_2
subtraction = Subtraction(A=lng, B="1")
boxprop = BoxProperties(Box=bbox.Box)  # -> Center, Diagonal, Area, Volume, Degeneracy
division = Division(A=lng, B=rows)
multiplication = Multiplication(A=boxprop.Diagonal, B=expansion)
int = Integer(division)
# © a3 2021 / Creative Commons Attribution-Non Commercial-ShareAlike 4.0 International License
devec = DeconstructVector(Vector=multiplication)  # -> XComponent, YComponent, ZComponent
recgrid = Rectangular(Plane=pt, SizeX=devec.XComponent, SizeY=devec.YComponent, ExtentX=int, ExtentY=rows)  # -> flatten(Cells), flatten(Points)
subset = SubList(List=recgrid.Cells, Domain=subtraction, Wrap=True)  # -> List, Index
pcen = PolygonCenter(Polyline=subset.List)  # -> CenterV, CenterE, CenterA
explode = Explode(Curve=subset.List, Recursive=True)  # -> Segments, Vertices
item = ListItem(List=explode.Vertices, Index=0, Wrap=True)  # -> flatten(Item)
multiplication_2 = Multiplication(A=devec.XComponent, B="0.05")
move = Move(Geometry=inblock_r6, Motion=pcen.CenterV)  # -> Geometry, Transform
vec = VectorXYZ(XComponent=multiplication_2, YComponent=multiplication_2, ZComponent=0)  # -> Vector, Length
bbox_2 = BoundingBox(Content=move.Geometry, Plane=PlaneXY(0, 0, 0))  # -> Box, Box_2
move_2 = Move(Geometry=item, Motion=vec.Vector)  # -> Geometry, Transform
edges = BrepEdges(Brep=bbox_2.Box)  # -> Naked, Interior, NonManifold

# ---- group: blocks
bake_r6 = BakeObjectsR6(Geometry=move.Geometry, Bake=False)

# ---- group: table cells
crv = Curve(subset.List)

# ---- group: base points
pt_2 = Point(pcen.CenterV)

# ---- group: Bounding boxes (curves)
crv_2 = Curve([edges.Naked, edges.Interior])

# ---- group: block names
tag = TextTag3D(Location=move_2.Geometry, Text=listblockd_r6, Size=multiplication_2, Justification=7)
