# Grasshopper definition Isovist path analysis.gh (Grasshopper 1.0.7)
# Copyright: Co-de-iT
# plug-ins: froGH, Human

# ---- group: isovist path
# Isovist path analysis
crv = Curve(<curve referenced from the Rhino model>)

# ---- group: Obstacles (actual geometries)
mesh = Mesh([<mesh referenced from the Rhino model> x2176])

# ---- group: base point for analysis plane
pt = Point(Point(71.8350264, -18.98025945, 11.5))

# ----
mjoin = MeshJoin(Meshes=flatten(mesh))
xy = XYPlane(Origin=pt)
# © a3 2021 / Creative Commons Attribution-Non Commercial-ShareAlike 4.0 International License
number_slider = Slider(0.714, range=0..1)
project = Project(Geometry=crv, Plane=xy)  # -> Geometry, Transform
sampling_distance = Slider(2, range=0.5..5)

# ---- group: isovist (point along curve)
eval = EvaluateCurve(Curve=reparameterize(project.Geometry), Parameter=number_slider)  # -> Point, Tangent, Angle

# ----
# <title>
# 
# <description>
# 
# code by Alessio Erioli
# 
# v 0.1
swatch = ColourSwatch(SwatchColor=RGB(0, 255, 255))
previewlw = CustomPreviewLineweights(Geometry=project.Geometry, Shader=swatch, Thickness="3", Absolute=False)
dots = DotDisplay(Point=eval.Point, Colour=RGB(0, 0, 0), Size="0.25")

len = Length(Curve=project.Geometry)
division = Division(A=len, B=sampling_distance)
int = Integer(division)
divide = DivideCurve(Curve=project.Geometry, Count=int, Kinks=False)  # -> Points, Tangents, Parameters
# Isovist shape from a point
ivist = IsoVist(Plane=eval.Point, Count=Slider(50, range=10..100), Radius=Slider(50, range=0..100), Obstacles=mjoin)  # -> Points, Distance, Index
pline = PolyLine(Vertices=ivist.Points, Closed="true")  # -> flatten(Polyline)
f_fmesh = FastMeshFromPolyline(Polylines=pline)
f_mrenorm = MeshRebuildNormals(Mesh=f_fmesh)

preview = CustomPreview(Geometry=f_mrenorm, Material=ColourSwatch(SwatchColor=RGBA(0, 255, 255, 155)))

# ----
# These values should be ok for 99% of cases - feel free to adjust them, but be careful
number_slider_2 = Slider(50, range=0..100)
number_slider_3 = Slider(50, range=10..100)

dam = DataDam(DataA=divide.Points, BufferDelay=10000000, BufferMode=0)
ivist_2 = IsoVist(Plane=dam, Count=number_slider_3, Radius=number_slider_2, Obstacles=mjoin)  # -> Points, Distance, Index

# ---- group: Max radial
sort = SortList(Keys=ivist_2.Distance)  # -> Keys, ValuesA
item = ListItem(List=sort.Keys, Index=0, Wrap=True)  # -> flatten(Item1), flatten(Item)

# ---- group: Average radial
avr = Average(Input=ivist_2.Distance)  # -> flatten(ArithmeticMean)

# ----
# This definition computes inherent geometrical or relational properties of Isovists as ‘measures’ and display spatial representations of how such measures are distributed in space as ‘fields’.
# 
# ‘Local’ isovist measures relate to occupant experience within space.
# 
# For more info on the formulas and meaning of each of the above measurements, visit:
# 
# https://isovists.org/user-guide-category/4-how-the-calculations-work/
panel = Panel("""Area
Perimeter
Average radial
Vista Length (Max radial)
Compactness
Drift
Variance
Skewness
Weighted % blocked rays""")

# ---- group: Data
list = ValueList({"Area": 0, "Perimeter": 1, "Average radial": 2, "Vista Length (Max radial)": 3, "Compactness": 4, "Drift": 5, "Variance": 6, "Skewness": 7, "_ Weighted % blocked rays": 8}, selected="Area")

# ---- group: Weighted % of blocked rays
smaller = SmallerThan(FirstNumber=ivist_2.Distance, SecondNumber=number_slider_2)  # -> SmallerThan, OrEqualTo
cull = CullPattern(List=ivist_2.Distance, CullPattern=smaller.SmallerThan)
ma = MassAddition(Input=cull)  # -> flatten(Result), PartialResults
division_2 = Division(A=ma.Result, B=number_slider_2)

# ----
# Drift: the vector connecting the sampling vertex V to the center of the isovist area
# 
# Directionality: considering the isovist rays from a sampling vertex V as vectors from V to the intersection point, the average of those vectors
list_2 = ValueList({"Drift": 0, "Directionality": 1}, selected="Drift")

# ----
# Measurements preceded by "_" are non-official measures
# 
# _ Weighted % of blocked rays: the % of obstructed rays from each sampling vertex V weighted by their length. It is an indicator of how much a space is  shielded from view and secluded. It can be related to intimacy or privacy levels. It can be loosely compared to the Occlusivity measure (https://isovists.org/user-guide/4-2-4-occlusivity/)
item_2 = ListItem(List=panel, Index=list, Wrap=True)
number_slider_4 = Slider(10, range=10..50)

min_size = Slider(0.1, range=0..1)
max_size = Slider(1, range=0..1)

multiplication = Multiplication(A=sampling_distance, B="0.5")
pln = Plane(xy)
pt_2 = Point(Point(82.84578353, -37.3172745, 0))
range = Range(Domain=Domain(0, 1), Steps=number_slider_4)

# ---- group: avoid visual Z conflict
Z = UnitZ(Factor="0.05")
move = Move(Geometry=dam, Motion=Z)  # -> Geometry, Transform

# ----
project_2 = Project(Geometry=pt_2, Plane=pln)  # -> Geometry, Transform
multiplication_2 = Multiplication(A=multiplication, B=min_size)
multiplication_3 = Multiplication(A=multiplication, B=max_size)
gradient = Gradient(
    LowerLimit=0,
    UpperLimit=1,
    Parameter=range,
    stops=[0: RGB(0, 0, 192), 0.204: RGB(1, 192, 229), 0.498: RGB(79, 186, 8), 0.797: RGB(220, 237, 32), 1: RGB(255, 0, 0)])
gradient_2 = Gradient(LowerLimit=0, UpperLimit=1, Parameter=range, stops=[0: RGB(0, 0, 0), 1: RGB(255, 255, 255)])
list_3 = ValueList({"Isovist classic": 0, "Grayscale": 1}, selected="Isovist classic")
num = Number(sampling_distance)
pl_origin = PlaneOrigin(Base=pln, Origin=project_2.Geometry)
deplane = DeconstructPlane(Plane=pl_origin)  # -> Origin, XAxis, YAxis, ZAxis
dom = ConstructDomain(DomainStart=multiplication_2, DomainEnd=multiplication_3)
multiplication_4 = Multiplication(A=num, B=Slider(0.2, range=0..1))
multiplication_5 = Multiplication(A=deplane.YAxis, B="-1")
filter = StreamFilter(Gate=list_3, Stream0=gradient, Stream1=gradient_2)
rectangle = Rectangle(Plane=pl_origin, XSize=Slider(1.5, range=0..50), YSize=Slider(20, range=0..50), Radius=0)  # -> Rectangle, Length
move_2 = Move(Geometry=pl_origin, Motion=multiplication_5)  # -> Geometry, Transform
# legend title
tag = TextTag3D(
    Location=move_2.Geometry,
    Text=item_2,
    Size=Slider(1, range=0.1..2),
    Colour=ColourSwatch(SwatchColor=RGB(0, 0, 0)),
    Justification=1)

# ----
# Isovist data computation
panel_2 = Panel("true")
subtraction = Subtraction(A=ivist_2.Distance, B=graft(avr))
pline_2 = PolyLine(Vertices=ivist_2.Points, Closed=panel_2)  # -> flatten(Polyline)
abs = Absolute(Value=subtraction)
area = Area(Geometry=pline_2)  # -> Area, Centroid

# ---- group: Perimeter
len_2 = Length(Curve=pline_2)

# ---- group: Variance
sqr = Square(Value=abs)
ma_2 = MassAddition(Input=sqr)  # -> Result, PartialResults
division_3 = Division(A=ma_2.Result, B=number_slider_3)
sqrt = SquareRoot(Value=division_3)  # -> flatten(Result)

# ---- group: Skewness
cube = Cube(Value=abs)
ma_3 = MassAddition(Input=cube)  # -> Result, PartialResults
division_4 = Division(A=ma_3.Result, B=number_slider_3)
cbrt = CubeRoot(Value=division_4)  # -> flatten(Result)

# ---- group: View drift/directionality
vec2pt = Vector2Pt(PointA=graft(dam), PointB=ivist_2.Points, Unitize=False)  # -> Vector, Length
avr_2 = Average(Input=vec2pt.Vector)  # -> flatten(ArithmeticMean)
number_slider_5 = Slider(3.794, range=0..10)
number_slider_6 = Slider(0.179, range=0..10)
vec2pt_2 = Vector2Pt(PointA=dam, PointB=area.Centroid, Unitize=False)  # -> Vector, Length
filter_2 = StreamFilter(Gate=list_2, Stream0=vec2pt_2.Vector, Stream1=avr_2)
vlen = VectorLength(Vector=filter_2)
bnd = Bounds(Numbers=vlen)
dom_2 = ConstructDomain(DomainStart=number_slider_6, DomainEnd=number_slider_5)
remap = RemapNumbers(Value=vlen, Source=bnd, Target=dom_2)  # -> Mapped, Clipped
amp = Amplitude(Vector=filter_2, Amplitude=remap.Mapped)
gradient_3 = Gradient(
    LowerLimit=number_slider_6,
    UpperLimit=number_slider_5,
    Parameter=remap.Mapped,
    stops=[0: RGB(0, 128, 0), 0.5: RGB(255, 255, 0), 1: RGB(255, 0, 0)])

# ----
compactness = Expression(A=area.Area, P=len_2, Expression="4 * π * A/pow(P,2)")

# ---- group: Drift
dist = Distance(PointA=dam, PointB=area.Centroid)

# ----
filter_3 = StreamFilter(
    Gate=list,
    Stream0=area.Area,
    Stream1=len_2,
    Stream2=avr,
    Stream3=item.Item1,
    Stream4=compactness,
    Stream5=dist,
    Stream6=sqrt,
    Stream7=cbrt,
    Stream8=division_2)
bnd_2 = Bounds(Numbers=filter_3)
remap_2 = RemapNumbers(Value=filter_3, Source=bnd_2, Target=Domain(0, 1))  # -> Mapped, Clipped
range_2 = Range(Domain=bnd_2, Steps=number_slider_4)
expression = Expression(x=remap_2.Mapped, Expression="Format(\"{0:0.00}\", x)")
expression_2 = Expression(x=range_2, Expression="Format(\"{0:0.00}\", x)")
gradient_4 = Gradient(
    LowerLimit=0,
    UpperLimit=1,
    Parameter=remap_2.Mapped,
    stops=[0: RGB(0, 0, 192), 0.204: RGB(1, 192, 229), 0.498: RGB(79, 186, 8), 0.797: RGB(220, 237, 32), 1: RGB(255, 0, 0)])
gradient_5 = Gradient(LowerLimit=0, UpperLimit=1, Parameter=remap_2.Mapped, stops=[0: RGB(0, 0, 0), 1: RGB(255, 255, 255)])
remap_3 = RemapNumbers(Value=remap_2.Mapped, Source=Domain(0, 1), Target=dom)  # -> Mapped, Clipped

# ----
# data display
# (turn on if needed)
tag_2 = TextTag3D(
    Location=move.Geometry,
    Text=expression,
    Size=multiplication_4,
    Colour=ColourSwatch(SwatchColor=RGB(10, 160, 194)),
    Justification=5)  # disabled

filter_4 = StreamFilter(Gate=list_3, Stream0=gradient_4, Stream1=gradient_5)
# vector display
# (turn on if needed)
vdisex = VectorDisplayEx(Point=move.Geometry, Vector=amp, Colour=gradient_3, Width=2)  # disabled
# dot display
dots_2 = DotDisplay(Point=dam, Colour=filter_4, Size=remap_3.Mapped)
# legend
legend = Legend(Colour=filter, Tags=expression_2, Rectangle=rectangle.Rectangle, LegendType=1)
