# Grasshopper definition Isovist plan analysis.gh (Grasshopper 1.0.7)
# Copyright: Co-de-iT
# plug-ins: froGH, Human

grid_plane_angle = Slider(0, range=-3.142..3.142)
grid_y_extension = Slider(40, range=0..100)
cell_size_resolution = Slider(1.5, range=1..10)
grid_x_extension = Slider(180, range=0..200)

# ---- group: Obstacles (actual geometries)
# Isovist plan analysis
mesh = Mesh([<mesh referenced from the Rhino model> x2176])

# ---- group: base point for analysis plane
pt = Point(Point(71.8350264, -18.98025945, 11.5))

# ----
# <title>
# 
# <description>
# 
# code by Alessio Erioli
# 
# v 0.1
# © a3 2021 / Creative Commons Attribution-Non Commercial-ShareAlike 4.0 International License
mjoin = MeshJoin(Meshes=flatten(mesh))
prot = RotatePlane(Plane=pt, Angle=grid_plane_angle)
division = Division(A=grid_x_extension, B=cell_size_resolution)
division_2 = Division(A=grid_y_extension, B=cell_size_resolution)
int = Integer(division)
int_2 = Integer(division_2)
rectangle = Rectangle(Plane=prot, XSize=grid_x_extension, YSize=grid_y_extension, Radius=0)  # -> Rectangle, Length
n_cells = Panel([int, int_2])
mplane = MeshPlane(Boundary=rectangle.Rectangle, WidthCount=int, HeightCount=int_2)  # -> Mesh, Area

# ---- group: only cells within the plan
# Height to be considered as part of the same level (pointing down)
number_slider = Slider(3, range=1..20)

facen = FaceNormals(Mesh=mplane.Mesh)  # -> Centers, Normals
panel = Panel("3")
line = LineSDL(Start=facen.Centers, Direction="0,0,-1", Length=number_slider)
mcx = MeshCurve(Mesh=mjoin, Curve=line)  # -> Points, Faces
lng = ListLength(List=mcx.Points)  # -> flatten(Length)
equals = Equality(FirstNumber=lng, SecondNumber="0")  # -> Equality, Inequality
cullf = CullFaces(Mesh=mplane.Mesh, Pattern=equals.Equality)

# ---- group: Analysis area
list = ValueList({"Full grid": 0, "Plan only": 1}, selected="Plan only")

# ----
filter = StreamFilter(Gate=list, Stream0=mplane.Mesh, Stream1=cullf)
dam = DataDam(DataA=filter, BufferDelay=10000000, BufferMode=0)

# ----
# These values should be ok for 99% of cases - feel free to adjust them, but be careful
number_slider_2 = Slider(50, range=0..100)
number_slider_3 = Slider(50, range=10..100)

demesh = DeconstructMesh(Mesh=dam)  # -> Vertices, Faces, Colours, Normals
ivist = IsoVist(Plane=demesh.Vertices, Count=number_slider_3, Radius=number_slider_2, Obstacles=mjoin)  # -> Points, Distance, Index

# ---- group: Max radial
sort = SortList(Keys=ivist.Distance)  # -> Keys, ValuesA
item = ListItem(List=sort.Keys, Index=0, Wrap=True)  # -> flatten(Item1), flatten(Item)

# ---- group: Data
list_2 = ValueList({"Area": 0, "Perimeter": 1, "Average radial": 2, "Vista Length (Max radial)": 3, "Compactness": 4, "Drift": 5, "Variance": 6, "Skewness": 7, "_ Weighted % blocked rays": 8}, selected="Area")

# ---- group: Average radial
avr = Average(Input=ivist.Distance)  # -> flatten(ArithmeticMean)

# ----
# This definition computes inherent geometrical or relational properties of Isovists as ‘measures’ and display spatial representations of how such measures are distributed in space as ‘fields’.
# 
# ‘Local’ isovist measures relate to occupant experience within space.
# 
# For more info on the formulas and meaning of each of the above measurements, visit:
# 
# https://isovists.org/user-guide-category/4-how-the-calculations-work/
panel_2 = Panel("""Area
Perimeter
Average radial
Vista Length (Max radial)
Compactness
Drift
Variance
Skewness
Weighted % blocked rays""")

# ---- group: Weighted % of blocked rays
smaller = SmallerThan(FirstNumber=ivist.Distance, SecondNumber=number_slider_2)  # -> SmallerThan, OrEqualTo
cull = CullPattern(List=ivist.Distance, CullPattern=smaller.SmallerThan)
ma = MassAddition(Input=cull)  # -> flatten(Result), PartialResults
division_3 = Division(A=ma.Result, B=number_slider_2)

# ----
# Drift: the vector connecting the sampling vertex V to the center of the isovist area
# 
# Directionality: considering the isovist rays from a sampling vertex V as vectors from V to the intersection point, the average of those vectors
list_3 = ValueList({"Drift": 0, "Directionality": 1}, selected="Drift")

# ----
# Measurements preceded by "_" are non-official measures
# 
# _ Weighted % of blocked rays: the % of obstructed rays from each sampling vertex V weighted by their length. It is an indicator of how much a space is  shielded from view and secluded. It can be related to intimacy or privacy levels. It can be loosely compared to the Occlusivity measure (https://isovists.org/user-guide/4-2-4-occlusivity/)
item_2 = ListItem(List=panel_2, Index=list_2, Wrap=True)
number_slider_4 = Slider(10, range=10..50)
pln = Plane(prot)
pt_2 = Point(Point(82.84578353, -37.3172745, 0))
range = Range(Domain=Domain(0, 1), Steps=number_slider_4)

# ---- group: avoid visual Z conflict
Z = UnitZ(Factor="0.05")
move = Move(Geometry=demesh.Vertices, Motion=Z)  # -> Geometry, Transform

# ----
project = Project(Geometry=pt_2, Plane=pln)  # -> Geometry, Transform
gradient = Gradient(
    LowerLimit=0,
    UpperLimit=1,
    Parameter=range,
    stops=[0: RGB(0, 0, 192), 0.204: RGB(1, 192, 229), 0.498: RGB(79, 186, 8), 0.797: RGB(220, 237, 32), 1: RGB(255, 0, 0)])
gradient_2 = Gradient(LowerLimit=0, UpperLimit=1, Parameter=range, stops=[0: RGB(0, 0, 0), 1: RGB(255, 255, 255)])
num = Number(cell_size_resolution)
list_4 = ValueList({"Isovist classic": 0, "Grayscale": 1}, selected="Isovist classic")
pl_origin = PlaneOrigin(Base=pln, Origin=project.Geometry)
deplane = DeconstructPlane(Plane=pl_origin)  # -> Origin, XAxis, YAxis, ZAxis
multiplication = Multiplication(A=num, B=Slider(0.2, range=0..1))
multiplication_2 = Multiplication(A=deplane.YAxis, B="-1")
rectangle_2 = Rectangle(Plane=pl_origin, XSize=Slider(1.5, range=0..50), YSize=Slider(20, range=0..50), Radius=0)  # -> Rectangle, Length
filter_2 = StreamFilter(Gate=list_4, Stream0=gradient, Stream1=gradient_2)
move_2 = Move(Geometry=pl_origin, Motion=multiplication_2)  # -> Geometry, Transform
# legend title
tag = TextTag3D(
    Location=move_2.Geometry,
    Text=item_2,
    Size=Slider(1, range=0.1..2),
    Colour=ColourSwatch(SwatchColor=RGB(0, 0, 0)),
    Justification=1)
range_2 = Range(Domain=Domain(0, 1), Steps=Slider(10, range=10..30))

# ----
# Isovist data computation
panel_3 = Panel("true")
subtraction = Subtraction(A=ivist.Distance, B=graft(avr))
pline = PolyLine(Vertices=ivist.Points, Closed=panel_3)  # -> flatten(Polyline)
abs = Absolute(Value=subtraction)
area = Area(Geometry=pline)  # -> Area, Centroid

# ---- group: Perimeter
len = Length(Curve=pline)

# ---- group: Variance
sqr = Square(Value=abs)
ma_2 = MassAddition(Input=sqr)  # -> Result, PartialResults
division_4 = Division(A=ma_2.Result, B=number_slider_3)
sqrt = SquareRoot(Value=division_4)  # -> flatten(Result)

# ---- group: Skewness
cube = Cube(Value=abs)
ma_3 = MassAddition(Input=cube)  # -> Result, PartialResults
division_5 = Division(A=ma_3.Result, B=number_slider_3)
cbrt = CubeRoot(Value=division_5)  # -> flatten(Result)

# ---- group: View drift/directionality
vec2pt = Vector2Pt(PointA=graft(demesh.Vertices), PointB=ivist.Points, Unitize=False)  # -> Vector, Length
avr_2 = Average(Input=vec2pt.Vector)  # -> flatten(ArithmeticMean)
number_slider_5 = Slider(3.794, range=0..10)
number_slider_6 = Slider(0.179, range=0..10)
vec2pt_2 = Vector2Pt(PointA=demesh.Vertices, PointB=area.Centroid, Unitize=False)  # -> Vector, Length
filter_3 = StreamFilter(Gate=list_3, Stream0=vec2pt_2.Vector, Stream1=avr_2)
vlen = VectorLength(Vector=filter_3)
bnd = Bounds(Numbers=vlen)
dom = ConstructDomain(DomainStart=number_slider_6, DomainEnd=number_slider_5)
remap = RemapNumbers(Value=vlen, Source=bnd, Target=dom)  # -> Mapped, Clipped
amp = Amplitude(Vector=filter_3, Amplitude=remap.Mapped)
gradient_3 = Gradient(
    LowerLimit=number_slider_6,
    UpperLimit=number_slider_5,
    Parameter=remap.Mapped,
    stops=[0: RGB(0, 128, 0), 0.5: RGB(255, 255, 0), 1: RGB(255, 0, 0)])

# ----
compactness = Expression(A=area.Area, P=len, Expression="4 * π * A/pow(P,2)")

# ---- group: Drift
dist = Distance(PointA=demesh.Vertices, PointB=area.Centroid)

# ----
filter_4 = StreamFilter(
    Gate=list_2,
    Stream0=area.Area,
    Stream1=len,
    Stream2=avr,
    Stream3=item.Item1,
    Stream4=compactness,
    Stream5=dist,
    Stream6=sqrt,
    Stream7=cbrt,
    Stream8=division_3)
bnd_2 = Bounds(Numbers=filter_4)
remap_2 = RemapNumbers(Value=filter_4, Source=bnd_2, Target=Domain(0, 1))  # -> Mapped, Clipped
range_3 = Range(Domain=bnd_2, Steps=number_slider_4)
expression = Expression(x=filter_4, Expression="Format(\"{0:0.00}\", x)")
expression_2 = Expression(x=range_3, Expression="Format(\"{0:0.00}\", x)")
gradient_4 = Gradient(
    LowerLimit=0,
    UpperLimit=1,
    Parameter=remap_2.Mapped,
    stops=[0: RGB(0, 0, 192), 0.204: RGB(1, 192, 229), 0.498: RGB(79, 186, 8), 0.797: RGB(220, 237, 32), 1: RGB(255, 0, 0)])
gradient_5 = Gradient(LowerLimit=0, UpperLimit=1, Parameter=remap_2.Mapped, stops=[0: RGB(0, 0, 0), 1: RGB(255, 255, 255)])

# ----
# data display
# (turn on if needed)
tag_2 = TextTag3D(
    Location=move.Geometry,
    Text=expression,
    Size=multiplication,
    Colour=ColourSwatch(SwatchColor=RGB(10, 160, 194)),
    Justification=5)  # disabled

filter_5 = StreamFilter(Gate=list_4, Stream0=gradient_4, Stream1=gradient_5)
mcol = MeshColours(Mesh=dam, Colours=filter_5)
# vector display
# (turn on if needed)
vdisex = VectorDisplayEx(Point=move.Geometry, Vector=amp, Colour=gradient_3, Width=2)  # disabled
# legend
legend = Legend(Colour=filter_2, Tags=expression_2, Rectangle=rectangle_2.Rectangle, LegendType=1)
filter_6 = StreamFilter(Gate=list_4, Stream1=mcol)
f_miso = MeshIsocurves(Mesh=filter_6, ColorChannel=0, Isovalue=range_2)

# ----
# isocurves display
# (only for grayscale gradient)
previewlw = CustomPreviewLineweights(Geometry=f_miso, Shader=ColourSwatch(SwatchColor=RGB(255, 0, 204)), Thickness="2", Absolute=False)
